# Grasshopper definition Classify_3_voxelize_and_send.ghx (Grasshopper 0.9.76)
# plug-ins: Python Interpreter, HDTReference

predict = Button()
selobj = ObjectsBySelection(Reset=predict)  # -> SelectedGeometry, ObjectAttributes
sortbytype = SortObjectsByType(RhinoObjects=selobj.SelectedGeometry)  # -> Points, Curves, Surfaces, Breps, Meshes, TextObjects, HatchObjects, LightObjects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
geo = Geometry([sortbytype.Breps, sortbytype.Extrusions])
rec = DataRecorder(geo, DataLimit=1, RecordData=True)
number_of_voxels_per_side = Slider(10, range=0..10)

# ---- group: Voxelization
geo_2 = Geometry(rec)
smallest_cube_around_object = Smallest_Cube_Around_Object(C=geo_2)  # -> geo_2, num_2
make_points_from_box = Make_Points_From_Box(geo=smallest_cube_around_object.geo_2, num=number_of_voxels_per_side)  # -> G, dimension_of_cube_2
inclusion_test = Inclusion_test(geo=geo_2, geo_3=make_points_from_box.G)  # -> bool_2, geo_6
geo_3 = Geometry(inclusion_test.geo_6)

# ----
int = Integer(inclusion_test.bool_2)
dam = DataDam(DataA=int, BufferDelay=2500000, BufferMode=2)
ganggang_send = PythonScript(Activate=Toggle(True), Host="172.16.15.1", Port="9092", Data=dam)  # -> out, Result, dump; inputs Port: Int32, Data: list
# ---------- ganggang_send: Python ----------
import socket
import pickle

dump = pickle.dumps(Data, 0)


if (Activate):
    
    clientsocket = socket.socket(socket.AF_INET, socket.SOCK_STREAM)
    try:
        clientsocket.connect((Host, Port))
    except Exception, e:
        print e
    clientsocket.send(dump)
    
    data = ""
    data = clientsocket.recv(1024)
    print 'Received', repr(data)
    Result = data
    clientsocket.close()
# ---------- end ganggang_send ----------
md_slider = MDSlider(
    slider_value=Point(0.5490886409, 0.8435456811, 0.5),
    SliderMode=0,
    x_domain=Domain(-1, 1),
    y_domain=Domain(-1, 1),
    z_domain=Domain(0, 1))
panel = Panel(ganggang_send.Result)
panel_2 = Panel(ganggang_send.dump)
multiplication = Multiplication(A=md_slider, B=Slider(252, range=0..300))
Z = UnitZ(Factor=Slider(37, range=0..100))
texttoscreen = RenderTextToScreen(
    Text=ganggang_send.Result,
    Location=multiplication,
    Size=Slider(16, range=0..100),
    Color=ColourSwatch(SwatchColor=RGB(163, 44, 255)),
    m_scWithvp=False)
md_slider_2 = MDSlider(
    slider_value=Point(0.2317073171, 0.4951219326, 0.5),
    SliderMode=0,
    x_domain=Domain(0, 1),
    y_domain=Domain(0, 1),
    z_domain=Domain(0, 1))
panel_3 = Panel("""GH -> Keras (Tensorflow) -> GH
Machine Learning (neural net)
object classification proof-of-concept
@dantaeyoung 160612""")
multiplication_2 = Multiplication(A=md_slider_2, B=Slider(100, range=0..100))
texttoscreen_2 = RenderTextToScreen(Size=12, Color=RGB(0, 0, 0), m_scWithvp=False)
texttoscreen_3 = RenderTextToScreen(
    Text=panel_3,
    Location=multiplication_2,
    Size=Slider(16, range=0..100),
    Color=ColourSwatch(SwatchColor=RGB(11, 7, 0)),
    Font="Arial",
    m_scWithvp=False)

# ---- group: representation
num = Number(expr("x/2", make_points_from_box.dimension_of_cube_2))
xy = XYPlane(Origin=Point(0, 0, 0))
number_slider = Slider(1, range=0..1)

# ----
box = CenterBox(Base=xy, X=num, Y=num, Z=num)

# ---- group: representation (continued)
mbox = MeshBox(Base=box, XCount=number_slider, YCount=number_slider, ZCount=number_slider)
orient = Orient(Geometry=mbox, Source=xy, Target=inclusion_test.geo_6)  # -> Geometry, Transform
clean = CleanTree(RemoveNulls=True, RemoveInvalid=True, RemoveEmpty=False, Tree=orient.Geometry)

# ----
move = Move(Geometry=clean, Motion=Z)  # -> Geometry, Transform

# ---- group: representation (continued)
geo_4 = Geometry(move.Geometry)
medges = MeshEdges(Mesh=geo_4)  # -> NakedEdges, InteriorEdges, NonManifoldEdges
preview = CustomPreview(
    Geometry=[medges.NakedEdges, medges.InteriorEdges, medges.NonManifoldEdges, geo_4],
    Shader=ColourSwatch(SwatchColor=RGBA(62, 31, 255, 57)))

# ==== cluster Smallest_Cube_Around_Object
C = ClusterInput()
bbox = BoundingBox(Content=C, Plane=PlaneXY(0, 0, 0))  # -> Box, Box_2
debox = DeconstructBox(Box=bbox.Box)  # -> Plane, X, Y, Z
bnd = Bounds(Numbers=[debox.Z, debox.X, debox.Y])
dedomain = DeconstructDomain(Domain=bnd)  # -> Start, End
volume = Volume(Geometry=bbox.Box)  # -> Volume, Centroid
division = Division(A=dedomain.End, B="2")
box = CenterBox(Base=volume.Centroid, X=division, Y=division, Z=division)
geo = Geometry(box)
num = Number(dedomain.End)
geo_2 = ClusterOutput(geo)
num_2 = ClusterOutput(num)

# ==== cluster Make_Points_From_Box
geo = ClusterInput()
debox = DeconstructBox(Box=geo)  # -> Plane, X, Y, Z
num = ClusterInput()
num_2 = Number(debox.X)
num_3 = Number(num)
lowerleftpoint = LowerLeftPoint(geo=geo)
division = Division(A=num_2, B=num_3)
division_2 = Division(A=division, B="2")
num_4 = Number(division_2)
num_5 = Number(division_2)
vec = VectorXYZ(XComponent=num_4, YComponent=num_4, ZComponent=num_4)  # -> Vector, Length
dimension_of_cube = Number(division)
move = Move(Geometry=lowerleftpoint, Motion=vec.Vector)  # -> Geometry, Transform
box = CenterBox(Base=lowerleftpoint, X=num_5, Y=num_5, Z=num_5)
dimension_of_cube_2 = ClusterOutput(dimension_of_cube)
arrbox = BoxArray(Geometry=move.Geometry, Cell=box, XCount=num_3, YCount=num_3, ZCount=num_3)  # -> Geometry, Transform
G = ClusterOutput(arrbox.Geometry)

# ==== cluster Inclusion_test
geo = ClusterInput()
geo_2 = Geometry(geo)
geo_3 = ClusterInput()
mesh = MeshBrep(
    Brep=geo_2,
    Settings={GridMaxCount=0, GridMinCount=16, JaggedSeams=False, MaxEdgeLength=0, MinEdgeLength=0.0001, MinTolerance=0, Refine=True, RefineAngle=0, RelativeTolerance=0.65, SimplePlanes=True, Tolerance=0})
geo_4 = Geometry(geo_3)
ma = MassAddition(Input=mesh)  # -> Result, PartialResults
filter = StreamFilter(Gate=ma.Result, Stream0=geo_2, Stream1=mesh)
minc = MeshInclusion(Mesh=filter, Point=geo_4, Strict=False)
sift = SiftPattern(List=geo_4, SiftPattern=minc)  # -> Output0, Output1
bool = Boolean(minc)
geo_5 = Geometry(sift.Output1)
bool_2 = ClusterOutput(bool)
geo_6 = ClusterOutput(geo_5)

# ==== cluster LowerLeftPoint
geo = ClusterInput()
geo_2 = Geometry(geo)
bbox = BoundingBox(Content=geo_2, Plane=PlaneXY(0, 0, 0), UnionBox=True)  # -> Box, Box_2
debrep = DeconstructBrep(Brep=bbox.Box)  # -> Faces, Edges, Vertices
sort_pt = SortPoints(Points=debrep.Vertices)  # -> Points, Indices
item = ListItem(List=sort_pt.Points, Index=0, Wrap=True)
pt = Geometry(item)
pt_2 = ClusterOutput(pt)
